# Dynamo graph portal frame.dyn (Dynamo 2.6.1.8786)
# packages: IГIS 0.1.1

# group: License
# note: GNU License
# This program is free software, you can redistribute it and/or modify it under the terms GNU General Public License as pubmished by the Free Software Foundation, either version 3 of the License, or (at your option) any later version.
# This program is distributed in the hope that it will be useful, but WITHOUT ANY WARRANTY, without even the implied warranty of MERCHANTABILITY or FITNESS FOR A PARTICULAR PURPOSE. See the GNU General Public License for more details.
# You should have received a copy of the GNU General Public License along with this program. If not, see http://www.gnu.org/licenses/

# group: Background
# note: for workflow

# group: Input
# note: for selection and whatnot

# group: Control
# note: for sliders and other option

# group: To Revit
# note: for changes made to Revit

# group: Annotation
# note: for notes and titles

# group: Info
# note: for general information

# group: Other
# note: for general other needs

# group: Portal Frame Geometry Input
control_point = CodeBlock { 0; }
control_point_2 = CodeBlock { 0; }
portal_height = CodeBlock { 9; }
control_point_3 = CodeBlock { 0; }
portal_width = CodeBlock { 12; }
control_point_4 = CodeBlock { 0; }
rafter_jackroof_rafter_angle = IntegerSlider(8, range=1..45 step 1)
control_point_5 = CodeBlock { 0; }
jackroof_column_from_apex_in = DoubleSlider(0.8, range=0.5..0.9 step 0.1)  # "Jackroof Column From Apex (in ratio)"
jackroof_column_height = DoubleSlider(1, range=0..20 step 0.1)

# group: Points Creation
byCoordinates = Point.ByCoordinates(x=control_point, y=control_point_2, z=portal_height)
portal_width_2 = Watch(portal_width)
byCoordinates_2 = Point.ByCoordinates(x=portal_width_2, y=control_point_2, z=portal_height)
byCoordinates_3 = Point.ByCoordinates(x=control_point_3, y=control_point_4, z=control_point_5)
byCoordinates_4 = Point.ByCoordinates(x=portal_width, y=control_point_4, z=control_point_5)

# group: Apex Point based on angle calculation
code_block = CodeBlock(x1=control_point_3, x2=portal_width_2) { (x1 + x2) / 2; }
tan = Math.Tan(angle=rafter_jackroof_rafter_angle)
code_block_2 = CodeBlock(y1=code_block, x1=tan) { y1 * x1; }
code_block_3 = CodeBlock(y1=code_block_2, y2=portal_height) { y1 + y2; }
byCoordinates_5 = Point.ByCoordinates(x=code_block, y=control_point_4, z=code_block_3)

# group: Portal Line Creation
byStartPointEndPoint = Line.ByStartPointEndPoint(startPoint=byCoordinates, endPoint=byCoordinates_5)
byStartPointEndPoint_2 = Line.ByStartPointEndPoint(startPoint=byCoordinates_2, endPoint=byCoordinates_5)
byStartPointEndPoint_3 = Line.ByStartPointEndPoint(startPoint=byCoordinates_3, endPoint=byCoordinates)
byStartPointEndPoint_4 = Line.ByStartPointEndPoint(startPoint=byCoordinates_4, endPoint=byCoordinates_2)

# group: To Revit
structural_framing_types = StructuralFramingTypes("UB610x305x149")
structural_column_types = StructuralColumnTypes("UC356x406x634")
structural_column_types_2 = StructuralColumnTypes("UB203x133x25")
structural_framing_types_2 = StructuralFramingTypes("UB203x133x25")
bracing_types = StructuralFramingTypes("CHS193.7x12.5")
tie_beam_types = StructuralFramingTypes("UB127x76x13")

# group: To Revit
levels = Levels("Level 1")
portal_rafter_type = Watch(structural_framing_types)
beamByCurve = StructuralFraming.BeamByCurve(curve=byStartPointEndPoint, level=levels, structuralFramingType=portal_rafter_type)
beamByCurve_2 = StructuralFraming.BeamByCurve(curve=byStartPointEndPoint_2, level=levels, structuralFramingType=portal_rafter_type)
levels_2 = Levels("Level 1")
portal_column_type = Watch(structural_column_types)
columnByCurve = StructuralFraming.ColumnByCurve(curve=byStartPointEndPoint_3, level=levels_2, structuralColumnType=portal_column_type)
columnByCurve_2 = StructuralFraming.ColumnByCurve(curve=byStartPointEndPoint_4, level=levels_2, structuralColumnType=portal_column_type)

# group: Jackroof Points Creation
ratio = Watch(jackroof_column_from_apex_in)
length = Curve.Length(curve=byStartPointEndPoint)
code_block_4 = CodeBlock(Ratio=ratio, rafterLength=length) { Ratio*rafterLength; }
pointAtSegmentLength = Curve.PointAtSegmentLength(curve=byStartPointEndPoint, segmentLength=code_block_4)
control_point_6 = CodeBlock { 0; }
jackroof_column_height_2 = Watch(jackroof_column_height)
translate = Geometry.Translate(geometry=pointAtSegmentLength, xTranslation=control_point_6, yTranslation=control_point_6, zTranslation=jackroof_column_height_2)
length_2 = Curve.Length(curve=byStartPointEndPoint_2)
code_block_5 = CodeBlock(Ratio=ratio, rafterLength=length_2) { Ratio*rafterLength; }
pointAtSegmentLength_2 = Curve.PointAtSegmentLength(curve=byStartPointEndPoint_2, segmentLength=code_block_5)
translate_2 = Geometry.Translate(geometry=pointAtSegmentLength_2, xTranslation=control_point_6, yTranslation=control_point_6, zTranslation=jackroof_column_height_2)
apex_point = Watch(byCoordinates_5)
translate_3 = Geometry.Translate(geometry=apex_point, xTranslation=control_point_6, yTranslation=control_point_6, zTranslation=jackroof_column_height_2)

# group: Jackroof Line Creation
byStartPointEndPoint_5 = Line.ByStartPointEndPoint(startPoint=pointAtSegmentLength, endPoint=translate)
byStartPointEndPoint_6 = Line.ByStartPointEndPoint(startPoint=pointAtSegmentLength_2, endPoint=translate_2)
byStartPointEndPoint_7 = Line.ByStartPointEndPoint(startPoint=translate, endPoint=translate_3)
byStartPointEndPoint_8 = Line.ByStartPointEndPoint(startPoint=translate_2, endPoint=translate_3)

# group: To Revit
levels_3 = Levels("Level 1")
jackroof_column_type = Watch(structural_column_types_2)
columnByCurve_3 = StructuralFraming.ColumnByCurve(curve=byStartPointEndPoint_5, level=levels_3, structuralColumnType=jackroof_column_type)
columnByCurve_4 = StructuralFraming.ColumnByCurve(curve=byStartPointEndPoint_6, level=levels_3, structuralColumnType=jackroof_column_type)
levels_4 = Levels("Level 1")
jackroof_rafter_type = Watch(structural_framing_types_2)
beamByCurve_3 = StructuralFraming.BeamByCurve(curve=byStartPointEndPoint_7, level=levels_4, structuralFramingType=jackroof_rafter_type)
beamByCurve_4 = StructuralFraming.BeamByCurve(curve=byStartPointEndPoint_8, level=levels_4, structuralFramingType=jackroof_rafter_type)

# group: Input
code_block_6 = CodeBlock { 0; }
number_of_frames = CodeBlock { 10; }
portal_frames_spacing = CodeBlock { 9; }
code_block_7 = CodeBlock(start=code_block_6, numberofFrames=number_of_frames, spacing=portal_frames_spacing) { start..#numberofFrames..spacing; }
list_of_frames_position = List.RemoveItemAtIndex(list=code_block_7, indices=code_block_6)

# group: Copy Frames Geometry
list_create = List.Create(item0=byStartPointEndPoint_3, item1=byStartPointEndPoint_4, item2=byStartPointEndPoint, item3=byStartPointEndPoint_2, item4=byStartPointEndPoint_5, item5=byStartPointEndPoint_6, item6=byStartPointEndPoint_7, item7=byStartPointEndPoint_8)
control_point_7 = CodeBlock { 0; }
geometry_translate_cross_lacing = Geometry.Translate(geometry=list_create, xTranslation=control_point_7, yTranslation=list_of_frames_position, zTranslation=control_point_7, lacing=CrossProduct)

# group: Column Lines
code_block_8 = CodeBlock { [0,1]; }
getItemAtIndex = List.GetItemAtIndex(list=geometry_translate_cross_lacing, index=code_block_8)

# group: Rafter Lines
code_block_9 = CodeBlock { [2,3]; }
getItemAtIndex_2 = List.GetItemAtIndex(list=geometry_translate_cross_lacing, index=code_block_9)

# group: To Revit
levels_5 = Levels("Level 1")
portal_column_type_2 = Watch(structural_column_types)
columnByCurve_5 = StructuralFraming.ColumnByCurve(curve=getItemAtIndex, level=levels_5, structuralColumnType=portal_column_type_2)
levels_6 = Levels("Level 1")
portal_rafter_type_2 = Watch(structural_framing_types)
beamByCurve_5 = StructuralFraming.BeamByCurve(curve=getItemAtIndex_2, level=levels_6, structuralFramingType=portal_rafter_type_2)

# group: Jackroof Rafter Lines
code_block_10 = CodeBlock { [6,7]; }
getItemAtIndex_3 = List.GetItemAtIndex(list=geometry_translate_cross_lacing, index=code_block_10)

# group: Jackroof Column Lines
code_block_11 = CodeBlock { [4,5]; }
getItemAtIndex_4 = List.GetItemAtIndex(list=geometry_translate_cross_lacing, index=code_block_11)

# group: To Revit
levels_7 = Levels("Level 1")
jackroof_rafter_type_2 = Watch(structural_framing_types_2)
beamByCurve_6 = StructuralFraming.BeamByCurve(curve=getItemAtIndex_3, level=levels_7, structuralFramingType=jackroof_rafter_type_2)
levels_8 = Levels("Level 1")
jackroof_column_type_2 = Watch(structural_column_types_2)
columnByCurve_6 = StructuralFraming.ColumnByCurve(curve=getItemAtIndex_4, level=levels_8, structuralColumnType=jackroof_column_type_2)

# group: Copy eaves points
eaves_points = List.Create(item0=byCoordinates, item1=byCoordinates_2)
control_point_8 = CodeBlock { 0; }
geometry_translate_cross_lacing_2 = Geometry.Translate(geometry=eaves_points, xTranslation=control_point_8, yTranslation=list_of_frames_position, zTranslation=control_point_8, lacing=CrossProduct)

# group: Add points to the front of list and create line based on translated points
code_block_12 = CodeBlock { 0; }
getItemAtIndex_5 = List.GetItemAtIndex(list=geometry_translate_cross_lacing_2, index=code_block_12)
addItemToFront = List.AddItemToFront(item=byCoordinates, list=getItemAtIndex_5)
eave_tie_beam_1 = PolyCurve.ByPoints(points=addItemToFront)
code_block_13 = CodeBlock { 1; }
getItemAtIndex_6 = List.GetItemAtIndex(list=geometry_translate_cross_lacing_2, index=code_block_13)
addItemToFront_2 = List.AddItemToFront(item=byCoordinates_2, list=getItemAtIndex_6)
eave_tie_beam_2 = Line.ByBestFitThroughPoints(bestFitPoints=addItemToFront_2)

# group: Points at mid column line
code_block_14 = CodeBlock { 0.5; }
pointAtParameter = Curve.PointAtParameter(curve=byStartPointEndPoint_3, param=code_block_14)
pointAtParameter_2 = Curve.PointAtParameter(curve=byStartPointEndPoint_4, param=code_block_14)

# group: Copy mid column points
eaves_points_2 = List.Create(item0=pointAtParameter, item1=pointAtParameter_2)
control_point_9 = CodeBlock { 0; }
geometry_translate_cross_lacing_3 = Geometry.Translate(geometry=eaves_points_2, xTranslation=control_point_9, yTranslation=list_of_frames_position, zTranslation=control_point_9, lacing=CrossProduct)

# group: Add points to the front of list and create line based on translated points
code_block_15 = CodeBlock { 0; }
getItemAtIndex_7 = List.GetItemAtIndex(list=geometry_translate_cross_lacing_3, index=code_block_15)
addItemToFront_3 = List.AddItemToFront(item=pointAtParameter, list=getItemAtIndex_7)
mid_column_tie_beam_1 = Line.ByBestFitThroughPoints(bestFitPoints=addItemToFront_3)
code_block_16 = CodeBlock { 1; }
getItemAtIndex_8 = List.GetItemAtIndex(list=geometry_translate_cross_lacing_3, index=code_block_16)
addItemToFront_4 = List.AddItemToFront(item=pointAtParameter_2, list=getItemAtIndex_8)
mid_column_tie_beam_2 = Line.ByBestFitThroughPoints(bestFitPoints=addItemToFront_4)

# group: Reindex Points and Chop List into sublist of two. Cross lacing to find the X lines combination
code_block_17 = CodeBlock { 2; }
chop = List.Chop(list=addItemToFront, lengths=code_block_17)
code_block_18 = CodeBlock { 1; }
shiftIndices = List.ShiftIndices(list=addItemToFront_3, amount=code_block_18)
chop_2 = List.Chop(list=shiftIndices, lengths=code_block_17)
byStartPointEndPoint_9 = Line.ByStartPointEndPoint(startPoint=chop, endPoint=chop_2, lacing=CrossProduct)

# group: Calculate logical X bracing diagonal length (a2 + b2 = c2)
code_block_19 = CodeBlock { 2; }
pow = Math.Pow(number=portal_height, power=code_block_19)
pow_2 = Math.Pow(number=portal_frames_spacing, power=code_block_19)
code_block_20 = CodeBlock(horizontal=pow, vertical=pow_2) { horizontal+vertical; }
sqrt = Math.Sqrt(number=code_block_20)
code_block_21 = CodeBlock { 0; }
round = Math.Round(number=sqrt, digits=code_block_21)

# group: Filter out unreasonable length of X bracing
length_3 = Curve.Length(curve=byStartPointEndPoint_9)
ge = round >= length_3
filterByBoolMask = List.FilterByBoolMask(list=byStartPointEndPoint_9, mask=ge)
flatten = List.Flatten(list=filterByBoolMask.out)
flatten_2 = List.Flatten(list=filterByBoolMask.in)

# note: SHOUTOUTS!
IГIS = Node_Storage()
control_point_10 = CodeBlock { 0; }

# group: Copy Bracing to other column side
portal_width_3 = Watch(portal_width)
geometry_translate_cross_lacing_4 = Geometry.Translate(geometry=flatten_2, xTranslation=portal_width_3, yTranslation=control_point_10, zTranslation=control_point_10, lacing=CrossProduct)

code_block_22 = CodeBlock(param=code_block_14, portalHeight=portal_height) { -param*portalHeight; }

# group: Copy bracing bothsides to lower part of column
list_create_2 = List.Create(item0=flatten_2, item1=geometry_translate_cross_lacing_4)
geometry_translate_cross_lacing_5 = Geometry.Translate(geometry=list_create_2, xTranslation=control_point_10, yTranslation=control_point_10, zTranslation=code_block_22, lacing=CrossProduct)

# group: To Revit
all_side_bracings = List.Create(item0=flatten_2, item1=geometry_translate_cross_lacing_4, item2=geometry_translate_cross_lacing_5)
levels_9 = Levels("Level 1")
bracing_type = Watch(bracing_types)
beamByCurve_7 = StructuralFraming.BeamByCurve(curve=all_side_bracings, level=levels_9, structuralFramingType=bracing_type)

# group: To Revit
all_side_tie_beams = List.Create(item0=eave_tie_beam_1, item1=eave_tie_beam_2, item2=mid_column_tie_beam_1, item3=mid_column_tie_beam_2)
levels_10 = Levels("Level 1")
tie_beam_type = Watch(tie_beam_types)
beamByCurve_8 = StructuralFraming.BeamByCurve(curve=all_side_tie_beams, level=levels_10, structuralFramingType=tie_beam_type)
